# Grasshopper definition Derivatives.gh (Grasshopper 1.0.7)

panel = Panel("D:\CloudStorage\OneDrive\current_files\SCI6338\Class\Assignment[0]\Final_Adjusted\Cleaned_0bthvn.csv")
panel_2 = Panel("D:\CloudStorage\OneDrive\current_files\SCI6338\Class\Assignment[0]\Final_Adjusted\Cleaned_0Canon.csv")
panel_3 = Panel("D:\CloudStorage\OneDrive\current_files\SCI6338\Class\Assignment[0]\Final_Adjusted\Cleaned_0mzt.csv")
panel_4 = Panel("D:\CloudStorage\OneDrive\current_files\SCI6338\Class\Assignment[0]\Final_Adjusted\Score_cannon.csv")
file = ReadFile(File=panel_2, PerLineParse=True)
file_2 = ReadFile(File=panel_4, PerLineParse=True)
c_script = CSharpScript(data=file)  # -> out, timestamps, t0_origin_x, t0_origin_y, t0_origin_z, t0_xaxis_x, t0_xaxis_y, t0_xaxis_z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; inputs data: list of String
# ---------- c_script: C# usings ----------
using System.IO;
using System.Linq;
using System.Data;
using System.Drawing;
using System.Reflection;
using System.Windows.Forms;
using System.Xml;
using System.Xml.Linq;
using System.Runtime.InteropServices;

using Rhino.DocObjects;
using Rhino.Collections;
using GH_IO;
using GH_IO.Serialization;
# ---------- c_script: C# ----------
    // In this file, we will parse the CSV file with the recording, and get the values
    // of the objects as numerical lists.
    // Before starting to add your own code, we recommend you read through the whole
    // file, understand the code that is already given to you, and get a sense of
    // what you are asked to complete! :)

    // Let's create a bunch of lists to store all the indidivual components of the input data!
    // If instead of outputtting individual values, you would like to ouput
    // actual geometrical objects, look at the next example in this GH file.

    // Timestamps must be stored as longs (really big integers):
    List<long> timestamp_values = new List<long>();

    // Point/vector components can be stored as doubles:
    List<double> t0_origin_x_values = new List<double>();
    List<double> t0_origin_y_values = new List<double>();
    List<double> t0_origin_z_values = new List<double>();

    // We will help you with a sample for boolean values:
    List<bool> t0_pressed_values = new List<bool>();

    // This is an incomplete list of incoming data -->
    // --> you should complete these lists, adding more here to store
    //     the values of the axes or other additional devices, etc.
    // Craete lists of doubles for the coordinates of the two
    // direction vectors.
  
    // (your code goes here... )
    List<double> t0_xaxis_x_values = new List<double>();
    List<double> t0_xaxis_y_values = new List<double>();
    List<double> t0_xaxis_z_values = new List<double>();
    List<double> t0_yaxis_x_values = new List<double>();
    List<double> t0_yaxis_y_values = new List<double>();
    List<double> t0_yaxis_z_values = new List<double>();



    // Let's iterate over all the string in the incoming data list, one per line.
    // Notice how we start with 1, because we want to skip the header in the file.
    for (int i = 1; i < data.Count; i++) {
      // Let's retrieve a line will all the data
      string dataRow = data[i];

      // Because it is a Comma-Separated Values (CSV) list, we values are separated with commas.
      // If we split the string with commas, we can get an array of strings with the individual values!
      // https://docs.microsoft.com/en-us/dotnet/api/system.string.split?view=netframework-4.5
      string[] dataColumns = dataRow.Split(',');  // notice how we use single quotes to indicate a char input

      // Let's get the timestamp! We know it was on the first column, so must be the first element
      // in the array. However, remember we read it as a string, so we must convert it to long first!
      // Then, we just push it to the appropriate list.
      string tsString = dataColumns[0];
      long ts = Convert.ToInt64(tsString);  // `long` is actually a nickname for `int64`, an integer with 64 bits capacity!
      timestamp_values.Add(ts);

      // Same thing with the coordinates of the origin of the first tracker:
      // - Retrieve the string element from the row,
      // - convert it to a double, and
      // - add it to the corresponding list.
      // As opposed to the long before, where we split each step of the process in one line of code,
      // ee will be shorthanding these three operations in one line:
      t0_origin_x_values.Add(Convert.ToDouble(dataColumns[1]));
      t0_origin_y_values.Add(Convert.ToDouble(dataColumns[2]));
      t0_origin_z_values.Add(Convert.ToDouble(dataColumns[3]));

      // And the final example, importing a boolean value!
      // Interestingly, this value is stored as an integer (0 or 1),
      // which is a very common representation of boolean values on CSVs.
      // We will need to read the string, convert it to an integer, and then to a boolean!
      int pressedNum = Convert.ToInt32(dataColumns[10]);
      bool pressed = pressedNum == 1;
      t0_pressed_values.Add(pressed);


      // That's it! With these examples, you probably have a good start on how to parse
      // the rest of the data back into Grasshopper. Just create more empty lists above,
      // and in this for loop, take elements from each row, convert them to their appropiate
      // type, and then push them to their appropriate lists.
      // You can parse through the whole CSV file with this technique.
      // Parse the coordinates of the vectors here:

      // (your code goes here... )
      t0_xaxis_x_values.Add(Convert.ToDouble(dataColumns[4]));
      t0_xaxis_y_values.Add(Convert.ToDouble(dataColumns[5]));
      t0_xaxis_z_values.Add(Convert.ToDouble(dataColumns[6]));
      t0_yaxis_x_values.Add(Convert.ToDouble(dataColumns[7]));
      t0_yaxis_y_values.Add(Convert.ToDouble(dataColumns[8]));
      t0_yaxis_z_values.Add(Convert.ToDouble(dataColumns[9]));

    }

    // Finally, remember to add more outputs to this GH component,
    // and output the Lists of data you just parsed.
    timestamps = timestamp_values;
    t0_origin_x = t0_origin_x_values;
    t0_origin_y = t0_origin_y_values;
    t0_origin_z = t0_origin_z_values;
    t0_pressed = t0_pressed_values;

    // (your code goes here... )
    t0_xaxis_x = t0_xaxis_x_values;
    t0_xaxis_y = t0_xaxis_y_values;
    t0_xaxis_z = t0_xaxis_z_values;
    t0_yaxis_x = t0_yaxis_x_values;
    t0_yaxis_y = t0_yaxis_y_values;
    t0_yaxis_z = t0_yaxis_z_values;
# ---------- end c_script ----------

# ---- group: Score Only
c_script_2 = CSharpScript(x=file_2)  # -> out, A; inputs x: list
# ---------- c_script_2: C# ----------
    List<object> Output = new List<object>();
    
    for (int i = 1; i < x.Count; i++)
    {
      Output.Add(x[i]);
    }
    
    A = Output;
# ---------- end c_script_2 ----------

# ----
panel_5 = Panel(c_script_2.A)

timestamps = Panel(c_script.timestamps)
org_x = Panel(c_script.t0_origin_x)
org_y = Panel(c_script.t0_origin_y)
org_z = Panel(c_script.t0_origin_z)
t0_x = Panel(c_script.t0_xaxis_x)
t0_y = Panel(c_script.t0_xaxis_y)
t0_z = Panel(c_script.t0_xaxis_z)
t1_x = Panel(c_script.t0_yaxis_x)
t1_y = Panel(c_script.t0_yaxis_y)
t1_z = Panel(c_script.t0_yaxis_z)

n_velocity = Slider(5, range=1..10)
n_velocity_2 = Slider(5, range=1..10)
n_velocity_3 = Slider(5, range=1..10)

# ---- group: Loop through the piece
timer = Timer(TimerInterval=50, Target=number_slider)  # disabled
number_slider = Slider(1, range=0..1)
rec = DataRecorder(number_slider, DataLimit=-10, RecordData=True)
ma = MassAddition(Input=rec)  # -> Result, PartialResults
c_script_3 = CSharpScript(timestamps=c_script.timestamps, iterator=ma.Result)  # -> out, A; inputs timestamps: list, iterator: Int32
# ---------- c_script_3: C# ----------
    //iterates throug each data point and loops the data for exploration
    int CurrrentIndex = iterator % timestamps.Count;
    A = CurrrentIndex;
# ---------- end c_script_3 ----------

# ---- group: Velocity Vector / Differentiatior
c_script_4 = CSharpScript(y=c_script.t0_xaxis_y, x=c_script.timestamps, n=n_velocity)  # -> out, A; inputs y: list of Double, x: list of Double, n: Int32
# ---------- c_script_4: C# ----------
    // pseudo code - the logic of how this works
    // pad the incoming list - add the extra mean values on top and bottom (the padding)
    // go through the entire list
    // calculate the difference in the initial and final value
    // add this to a list. (assumption here is that there is an entry every unit time)
    // Note: time is interpolated as a static - the pos vector is meaned out

    // Notes on variable names:
    // dy - the list that we are differentiating (change in some variable)
    // dx - the time variable (change in time)
    // window - specifies how pic or small the size of the delta is
    // (this is always actually always odd) - the value from the silder specifies
    //  how many neighbours
    // on top and bottom to sample- hence window value is always - 2n + 1
    // n is the neighbour value

    // the actual code starts here:

    // this is the actual list that we'll be adding values too
    List<double> Outputlist = new List<double>();

    // creating copies of the input lists cause its safer to code that way
    List<double> x_padded = x;
    List<double> y_padded = y;

    // calculate the padding value - we use the mean for ys
    List<double> padlist = y.GetRange(0, n);
    double padvalue_y = Mean(padlist);
    // for time we use the same value -+ n's degree

    // pad stuff
    for (int i = 0; i < n; i++)
    {
      // pad the front
      y_padded.Insert(0, padvalue_y);
      y_padded.Add(padvalue_y);

      x_padded.Insert(0, x[0] - i);
      x_padded.Add(x[x.Count - 1] + i);
    }

    // actually differentiate
    for (int i = n; i < y.Count - n; i++)
    {
      double dx1 = x_padded[i - n];
      double dx2 = x_padded[i + n];
      double dy1 = y_padded[i - n];
      double dy2 = y_padded[i + n];

      double variable = (dy2 - dy1) / (dx2 - dx1);
      Outputlist.Add(variable);
    }

    A = Outputlist;
# ---------- c_script_4: C# additional code ----------
  /// <summary>
  /// Helper function calculates the mean of the stuff that comes before
  ///This is mainly for the effective padding of the stuff that comes before
  /// </summary>
  /// <param name="ListOfNumbers"></param>
  /// <returns></returns>
  public double Mean(List<double> ListOfNumbers)
  {
    double summation = 0;
    double mean;

    foreach (double number in ListOfNumbers)
    {
      summation = summation + number;
    }

    mean = summation / ListOfNumbers.Count;

    return mean;
  }
# ---------- end c_script_4 ----------

c_script_5 = CSharpScript(y=c_script.t0_xaxis_x, x=c_script.timestamps, n=n_velocity)  # -> out, A; inputs y: list of Double, x: list of Double, n: Int32
# ---------- c_script_5: C# ----------
    // pseudo code - the logic of how this works
    // pad the incoming list - add the extra mean values on top and bottom (the padding)
    // go through the entire list
    // calculate the difference in the initial and final value
    // add this to a list. (assumption here is that there is an entry every unit time)
    // Note: time is interpolated as a static - the pos vector is meaned out

    // Notes on variable names:
    // dy - the list that we are differentiating (change in some variable)
    // dx - the time variable (change in time)
    // window - specifies how pic or small the size of the delta is
    // (this is always actually always odd) - the value from the silder specifies
    //  how many neighbours
    // on top and bottom to sample- hence window value is always - 2n + 1
    // n is the neighbour value

    // the actual code starts here:

    // this is the actual list that we'll be adding values too
    List<double> Outputlist = new List<double>();

    // creating copies of the input lists cause its safer to code that way
    List<double> x_padded = x;
    List<double> y_padded = y;

    // calculate the padding value - we use the mean for ys
    List<double> padlist = y.GetRange(0, n);
    double padvalue_y = Mean(padlist);
    // for time we use the same value -+ n's degree

    // pad stuff
    for (int i = 0; i < n; i++)
    {
      // pad the front
      y_padded.Insert(0, padvalue_y);
      y_padded.Add(padvalue_y);

      x_padded.Insert(0, x[0] - i);
      x_padded.Add(x[x.Count - 1] + i);
    }

    // actually differentiate
    for (int i = n; i < y.Count-n; i++)
    {
      double dx1 = x_padded[i - n];
      double dx2 = x_padded[i + n];
      double dy1 = y_padded[i - n];
      double dy2 = y_padded[i + n];
      
      double variable = (dy2 - dy1) / (dx2 - dx1);
      Outputlist.Add(variable);
    }
    
    A = Outputlist;
# ---------- c_script_5: C# additional code ----------
  /// <summary>
  /// Helper function calculates the mean of the stuff that comes before
  ///This is mainly for the effective padding of the stuff that comes before
  /// </summary>
  /// <param name="ListOfNumbers"></param>
  /// <returns></returns>
  public double Mean(List<double> ListOfNumbers)
  {
    double summation = 0;
    double mean;

    foreach (double number in ListOfNumbers)
    {
      summation = summation + number;
    }

    mean = summation / ListOfNumbers.Count;

    return mean;
  }
# ---------- end c_script_5 ----------

c_script_6 = CSharpScript(y=c_script.t0_xaxis_z, x=c_script.timestamps, n=n_velocity)  # -> out, A; inputs y: list of Double, x: list of Double, n: Int32; same code as c_script_5

c_script_7 = CSharpScript(y=c_script.t0_origin_y, x=c_script.timestamps, n=n_velocity_3)  # -> out, A; inputs y: list of Double, x: list of Double, n: Int32; same code as c_script_4

c_script_8 = CSharpScript(y=c_script.t0_origin_x, x=c_script.timestamps, n=n_velocity_3)  # -> out, A; inputs y: list of Double, x: list of Double, n: Int32; same code as c_script_5

c_script_9 = CSharpScript(y=c_script.t0_origin_z, x=c_script.timestamps, n=n_velocity_3)  # -> out, A; inputs y: list of Double, x: list of Double, n: Int32; same code as c_script_5

c_script_10 = CSharpScript(y=c_script.t0_yaxis_y, x=c_script.timestamps, n=n_velocity_2)  # -> out, A; inputs y: list of Double, x: list of Double, n: Int32; same code as c_script_4

c_script_11 = CSharpScript(y=c_script.t0_yaxis_x, x=c_script.timestamps, n=n_velocity_2)  # -> out, A; inputs y: list of Double, x: list of Double, n: Int32; same code as c_script_5

c_script_12 = CSharpScript(y=c_script.t0_yaxis_z, x=c_script.timestamps, n=n_velocity_2)  # -> out, A; inputs y: list of Double, x: list of Double, n: Int32; same code as c_script_5

# ---- group: Velocity Vector
vec = VectorXYZ(XComponent=c_script_5.A, YComponent=c_script_4.A, ZComponent=c_script_6.A)  # -> Vector, Length

vec_2 = VectorXYZ(XComponent=c_script_8.A, YComponent=c_script_7.A, ZComponent=c_script_9.A)  # -> Vector, Length

vec_3 = VectorXYZ(XComponent=c_script_11.A, YComponent=c_script_10.A, ZComponent=c_script_12.A)  # -> Vector, Length

# ---- group: AccelerationVec
c_script_13 = CSharpScript(y=c_script_8.A, x=c_script.timestamps, n=n_velocity_3)  # -> out, A; inputs y: list of Double, x: list of Double, n: Int32; same code as c_script_5
c_script_14 = CSharpScript(y=c_script_7.A, x=c_script.timestamps, n=n_velocity_3)  # -> out, A; inputs y: list of Double, x: list of Double, n: Int32; same code as c_script_5
c_script_15 = CSharpScript(y=c_script_9.A, x=c_script.timestamps, n=n_velocity_3)  # -> out, A; inputs y: list of Double, x: list of Double, n: Int32; same code as c_script_5
vec_4 = VectorXYZ(XComponent=c_script_13.A, YComponent=c_script_14.A, ZComponent=c_script_15.A)  # -> Vector, Length

c_script_16 = CSharpScript(y=c_script_5.A, x=c_script.timestamps, n=n_velocity)  # -> out, A; inputs y: list of Double, x: list of Double, n: Int32; same code as c_script_5
c_script_17 = CSharpScript(y=c_script_4.A, x=c_script.timestamps, n=n_velocity)  # -> out, A; inputs y: list of Double, x: list of Double, n: Int32; same code as c_script_5
c_script_18 = CSharpScript(y=c_script_6.A, x=c_script.timestamps, n=n_velocity)  # -> out, A; inputs y: list of Double, x: list of Double, n: Int32; same code as c_script_5
vec_5 = VectorXYZ(XComponent=c_script_16.A, YComponent=c_script_17.A, ZComponent=c_script_18.A)  # -> Vector, Length

c_script_19 = CSharpScript(y=c_script_11.A, x=c_script.timestamps, n=n_velocity_2)  # -> out, A; inputs y: list of Double, x: list of Double, n: Int32; same code as c_script_5
c_script_20 = CSharpScript(y=c_script_10.A, x=c_script.timestamps, n=n_velocity_2)  # -> out, A; inputs y: list of Double, x: list of Double, n: Int32; same code as c_script_5
c_script_21 = CSharpScript(y=c_script_12.A, x=c_script.timestamps, n=n_velocity_2)  # -> out, A; inputs y: list of Double, x: list of Double, n: Int32; same code as c_script_5
vec_6 = VectorXYZ(XComponent=c_script_19.A, YComponent=c_script_20.A, ZComponent=c_script_21.A)  # -> Vector, Length

# ----
c_script_22 = CSharpScript(
    timestamp=c_script.timestamps,
    Ox=c_script.t0_origin_x,
    Oy=c_script.t0_origin_y,
    Oz=c_script.t0_origin_z,
    T1x=c_script.t0_xaxis_x,
    T1y=c_script.t0_xaxis_y,
    T1z=c_script.t0_xaxis_z,
    T2x=c_script.t0_yaxis_x,
    T2y=c_script.t0_yaxis_y,
    T2z=c_script.t0_yaxis_z,
    DO=vec_2.Vector,
    DD=vec_4.Vector,
    DT0=vec.Vector,
    DDT0=vec_5.Vector,
    DT1=vec_3.Vector,
    DDT1=vec_6.Vector,
    IndexNumber=c_script_3.A)  # -> out, OX_ind, OY_ind, OZ_ind, T1x_ind, T1y_ind, T1z_ind, T2x_ind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; inputs timestamp: list, Ox: list, Oy: list, Oz: list, T1x: list, T1y: list, T1z: list, T2x: list, T2y: list, T2z: list, DO: list, DD: list, DT0: list, DDT0: list, DT1: list, DDT1: list, IndexNumber: Int32
# ---------- c_script_22: C# ----------
  OX_ind = Ox[IndexNumber];
  OY_ind = Oy[IndexNumber];
  OZ_ind = Oz[IndexNumber];
  T1x_ind = T1x[IndexNumber];
  T1y_ind = T1y[IndexNumber];
  T1z_ind = T1z[IndexNumber];
  T2x_ind = T2x[IndexNumber];
  T2y_ind = T2y[IndexNumber];
  T2z_ind = T2z[IndexNumber];
  Timestamp_ind = timestamp[IndexNumber];
  DO_ind = DO[IndexNumber];
  DD_ind = DD[IndexNumber];
  DT0_ind = DT0[IndexNumber];
  DDT0_ind = DDT0[IndexNumber];
  DT1_ind = DT1[IndexNumber];
  DDT1_ind = DDT1[IndexNumber];
# ---------- end c_script_22 ----------
pt = ConstructPoint(XCoordinate=c_script_22.OX_ind, YCoordinate=c_script_22.OY_ind, ZCoordinate=c_script_22.OZ_ind)
vlen = VectorLength(Vector=c_script_22.DO_ind)
vlen_2 = VectorLength(Vector=c_script_22.DD_ind)
vlen_3 = VectorLength(Vector=c_script_22.DT0_ind)
vlen_4 = VectorLength(Vector=c_script_22.DDT0_ind)
rec_2 = DataRecorder(pt, DataLimit=-10, RecordData=True)
expression = Expression(x=vlen, Expression="Floor(x*1000000)")
expression_2 = Expression(x=vlen_2, Expression="Floor(x*10000000)")
pt_2 = ConstructPoint(XCoordinate=c_script.t0_origin_x, YCoordinate=c_script.t0_origin_y, ZCoordinate=c_script.t0_origin_z)
expression_3 = Expression(x=vlen_4, Expression="Floor(x*10000000)")
expression_4 = Expression(x=vlen_3, Expression="Floor(x*100000)")
vec_7 = VectorXYZ(XComponent=c_script_22.OX_ind, YComponent=c_script_22.OY_ind, ZComponent=c_script_22.OZ_ind)  # -> Vector, Length
vec_8 = VectorXYZ(XComponent=c_script_22.OX_ind, YComponent=c_script_22.OY_ind, ZComponent=c_script_22.OZ_ind)  # -> Vector, Length
group = Group(Objects=pt_2)
data = Data(rec_2)
scale = Scale(Geometry=group, Center=Point(0, 0, 0), Factor=Slider(95, range=0..1000))  # -> Geometry, Transform

# ---- group: Sphere thing spawner
c_script_23 = CSharpScript(NumPoints=expression, Radius=expression_2)  # -> out, A; inputs NumPoints: Int32, Radius: Int32
# ---------- c_script_23: C# ----------
    // store the points that we generate
    List<Point3d> SpherePoints = new List<Point3d>();

    // Compute the golden ratio for later
    double GLratio = 1 + Math.Pow(5, 0.5);

    // add all the values of the
    for (int i = 0; i < NumPoints; i++)
    {
      double index = (i + 0.5);
      double phi = Math.Acos(1 - ((2*index)/NumPoints));
      Print(index.ToString());
      double theta = Math.PI * (GLratio) *index;

      ///#@Jose polar coordinates are better!!!
      double x = Radius * Math.Cos(theta) * Math.Sin(phi);
      double y = Radius * Math.Sin(theta) * Math.Sin(phi);
      double z = Radius * Math.Cos(phi);

      Point3d pnt = new Point3d(x, y, z);
      SpherePoints.Add(pnt);
    }

    A = SpherePoints;
# ---------- end c_script_23 ----------

# ----
multiplication = Multiplication(A=vec_7.Vector, B=Slider(95, range=0..1000))

# ---- group: Sphere thing spawner
c_script_24 = CSharpScript(NumPoints=expression_4, Radius=expression_3)  # -> out, A; inputs NumPoints: Int32, Radius: Int32; same code as c_script_23

# ----
ungroup = Ungroup(Group=scale.Geometry)
multiplication_2 = Multiplication(A=vec_8.Vector, B=Slider(95, range=0..1000))
data_2 = Data(flatten(ungroup))
pline = PolyLine(Vertices=data_2, Closed=False)
move = Move(Geometry=c_script_23.A, Motion=multiplication)  # -> Geometry, Transform
move_2 = Move(Geometry=c_script_24.A, Motion=multiplication_2)  # -> Geometry, Transform
preview = CustomPreview(Geometry=pline, Material=ColourSwatch(SwatchColor=RGB(115, 115, 115)))
