# Grasshopper definition Fologram_MotionTracker_Reader_v1_Complete_AM.gh (Grasshopper 1.0.7)

# C:\Users\Aakrity\OneDrive - Harvard University\6338 Computational Design\assignment[0]\Assignment Recording\Final files\Cleaned_0bthvn.csv
panel = Panel("C:\Users\Aakrity\OneDrive - Harvard University\6338 Computational Design\assignment[0]\Assignment Recording\Final files\Cleaned_0mzt.csv")

# ---- group: Let's use GH to read the CSV file into a List of strings. Make sure you replace the incoming path with wherever your file lives.
# #GSD6338
# Introduction to Computational Design
# Instructor: Jose Luis García del Castillo y López
# Harvard University Graduate School of Design
# Fologram_MotionTracker - CSV Data Reader
# This file contains a sample Grasshopper definition to read recorded motion information from a CSV file and reconstruct it in different ways.
# This file uses the Fologram plug-in to read from the phone and tablet: https://fologram.com/
# Authors: Joonhaeng Lee, Jose Luis García del Castillo y Lopez.
# 
# This file is part of a class assignment for GSD6338: Introduction to Computational Design.
# More info on: https://www.gsd.harvard.edu/course/introduction-to-computational-design-fall-2020/
panel_2 = Panel("C:\Users\Aakrity\OneDrive - Harvard University\6338 Computational Design\assignment[0]\Assignment Recording\Final files\Cleaned_0Canon.csv")
file = ReadFile(File=panel_2, PerLineParse=True)

# C:\Users\Aakrity\OneDrive - Harvard University\6338 Computational Design\assignment[0]\Assignment Recording\Final files\Cleaned_0Canon.csv
file_2 = ReadFile(File=panel, PerLineParse=True)

# ----
panel_3 = Panel(file)
c_script = CSharpScript(data=file_2)  # -> out, t0_planes, t0_pressed; inputs data: list of String
# ---------- c_script: C# usings ----------
using System.IO;
using System.Linq;
using System.Data;
using System.Drawing;
using System.Reflection;
using System.Windows.Forms;
using System.Xml;
using System.Xml.Linq;
using System.Runtime.InteropServices;

using Rhino.DocObjects;
using Rhino.Collections;
using GH_IO;
using GH_IO.Serialization;
# ---------- c_script: C# ----------
    // You have seen in the previous example how to read the CSV in an "atomic" way, element by element.
    // However, most likely, you will want to end up reconstructing that data back
    // into Points, Vectors and / or Planes. So why not doing it right away?
    // This example is very similar to the previous one, except that instead of outputting
    // the numerical values representing the origin Point for the first tracker,
    // we will output a List of actual Point3d objects!
    // (Remember, to read more about how to output doubles, booleans or longs,
    // check the previous example. We will ignore that part in this one.)
    // Read the whole file before modifying it!

    // Since we now want to output geometry, let's create an empty list of Point3d
    List<Point3d> t0_origin_point_values = new List<Point3d>();

    // We still will keep the pressed values as single booleans...
    List<bool> t0_pressed_values = new List<bool>();

    // You can now add more lists of Points, Vectors and/or probably Plane objects here!
    // (your code goes here... )
    List<Plane> t0_plane_objects = new List<Plane>();



    // Let's iterate over all the string in the incoming data list, one per line.
    // Notice how we start with 1, because we want to skip the header in the file.
    for (int i = 1; i < data.Count; i++) {
      // Let's retrieve a line will all the data
      string dataRow = data[i];

      // Because it is a Comma-Separated Values (CSV) list, we values are separated with commas.
      // If we split the string with commas, we can get an array of strings with the individual values!
      // https://docs.microsoft.com/en-us/dotnet/api/system.string.split?view=netframework-4.5
      string[] dataColumns = dataRow.Split(',');  // notice how we use single quotes to indicate a char input

      // Bringing in the booleans for `pressed`, just like we did in the previous component.
      int pressedNum = Convert.ToInt32(dataColumns[10]);
      bool pressed = pressedNum == 1;
      t0_pressed_values.Add(pressed);

      // We learnt how to read doubles, longs, bools, etc. before, so let's focus on geometry.
      // If I want to output the origin Point of the tracker, I will probably have to:
      // - Read the string coordinates of the point,
      // - convert them to doubles,
      // - create a Point3d object with them,
      // - and store the point object in my Point3d List.
      // Let's do it!
      double oX = Convert.ToDouble(dataColumns[1]);  // shorthanding reading and converting to double
      double oY = Convert.ToDouble(dataColumns[2]);
      double oZ = Convert.ToDouble(dataColumns[3]);
      Point3d origin = new Point3d(oX, oY, oZ);
      t0_origin_point_values.Add(origin);

      // // The code above could be shorthanded in one line, but it becomes very hard to read... :(
      // t0_origin_point_values.Add(new Point3d(Convert.ToDouble(dataColumns[1]), Convert.ToDouble(dataColumns[2]), Convert.ToDouble(dataColumns[3])));

      // That's pretty much it! Try now importing and constructing the direction Vectors for the tracker.
      // Or... wouldn't it just be easier to directly construct a Plane object for the
      // tracker with the Origin and the two main Vectors...? :)
      // Write code here to create two vectors from the coordinates in the CSV,
      // and either store them on lists or use them along with the origin point
      // to create a Plane object and store that one on a list for outputting! (RECOMMENDED)

      // (your code goes here... )
      Vector3d vx = new Vector3d(
        Convert.ToDouble(dataColumns[4]),
        Convert.ToDouble(dataColumns[5]),
        Convert.ToDouble(dataColumns[6]));
      Vector3d vy = new Vector3d(
        Convert.ToDouble(dataColumns[7]),
        Convert.ToDouble(dataColumns[8]),
        Convert.ToDouble(dataColumns[9]));

      Plane pl = new Plane(origin, vx, vy);
      t0_plane_objects.Add(pl);
    }

    // Finally, remember to add more outputs to this GH component,
    // and output the Lists of geometry you just created.
    // t0_origin_points = t0_origin_point_values;

    // Output here your list of `pressed` booleans,
    // and your direction vectors or your orientation plane!
    // (your code goes here... )
    t0_planes = t0_plane_objects;
    t0_pressed = t0_pressed_values;
# ---------- end c_script ----------

# ---- group: Also simple example of how to read the CSV file, this time outputting geometry elements / Double-click me to learn more!
c_script_2 = CSharpScript(data=file)  # -> out, t0_planes, t0_pressed; inputs data: list of String; same code as c_script

# ---- group: A simple example of how to read the CSV file into its individual data points / Double-click me to learn more!
c_script_3 = CSharpScript(data=file)  # -> out, timestamps, t0_origin_x, t0_origin_y, t0_origin_z, t0_xaxis_x, t0_xaxis_y, t0_xaxis_z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; inputs data: list of String
# ---------- c_script_3: C# ----------
    // In this file, we will parse the CSV file with the recording, and get the values
    // of the objects as numerical lists.
    // Before starting to add your own code, we recommend you read through the whole
    // file, understand the code that is already given to you, and get a sense of
    // what you are asked to complete! :)

    // Let's create a bunch of lists to store all the indidivual components of the input data!
    // If instead of outputtting individual values, you would like to ouput
    // actual geometrical objects, look at the next example in this GH file.

    // Timestamps must be stored as longs (really big integers):
    List<long> timestamp_values = new List<long>();

    // Point/vector components can be stored as doubles:
    List<double> t0_origin_x_values = new List<double>();
    List<double> t0_origin_y_values = new List<double>();
    List<double> t0_origin_z_values = new List<double>();

    // We will help you with a sample for boolean values:
    List<bool> t0_pressed_values = new List<bool>();

    // This is an incomplete list of incoming data -->
    // --> you should complete these lists, adding more here to store
    //     the values of the axes or other additional devices, etc.
    // Craete lists of doubles for the coordinates of the two
    // direction vectors.

    // (your code goes here... )
    List<double> t0_xaxis_x_values = new List<double>();
    List<double> t0_xaxis_y_values = new List<double>();
    List<double> t0_xaxis_z_values = new List<double>();
    List<double> t0_yaxis_x_values = new List<double>();
    List<double> t0_yaxis_y_values = new List<double>();
    List<double> t0_yaxis_z_values = new List<double>();



    // Let's iterate over all the string in the incoming data list, one per line.
    // Notice how we start with 1, because we want to skip the header in the file.
    for (int i = 1; i < data.Count; i++) {
      // Let's retrieve a line will all the data
      string dataRow = data[i];

      // Because it is a Comma-Separated Values (CSV) list, we values are separated with commas.
      // If we split the string with commas, we can get an array of strings with the individual values!
      // https://docs.microsoft.com/en-us/dotnet/api/system.string.split?view=netframework-4.5
      string[] dataColumns = dataRow.Split(',');  // notice how we use single quotes to indicate a char input

      // Let's get the timestamp! We know it was on the first column, so must be the first element
      // in the array. However, remember we read it as a string, so we must convert it to long first!
      // Then, we just push it to the appropriate list.
      string tsString = dataColumns[0];
      long ts = Convert.ToInt64(tsString);  // `long` is actually a nickname for `int64`, an integer with 64 bits capacity!
      timestamp_values.Add(ts);

      // Same thing with the coordinates of the origin of the first tracker:
      // - Retrieve the string element from the row,
      // - convert it to a double, and
      // - add it to the corresponding list.
      // As opposed to the long before, where we split each step of the process in one line of code,
      // ee will be shorthanding these three operations in one line:
      t0_origin_x_values.Add(Convert.ToDouble(dataColumns[1]));
      t0_origin_y_values.Add(Convert.ToDouble(dataColumns[2]));
      t0_origin_z_values.Add(Convert.ToDouble(dataColumns[3]));

      // And the final example, importing a boolean value!
      // Interestingly, this value is stored as an integer (0 or 1),
      // which is a very common representation of boolean values on CSVs.
      // We will need to read the string, convert it to an integer, and then to a boolean!
      int pressedNum = Convert.ToInt32(dataColumns[10]);
      bool pressed = pressedNum == 1;
      t0_pressed_values.Add(pressed);


      // That's it! With these examples, you probably have a good start on how to parse
      // the rest of the data back into Grasshopper. Just create more empty lists above,
      // and in this for loop, take elements from each row, convert them to their appropiate
      // type, and then push them to their appropriate lists.
      // You can parse through the whole CSV file with this technique.
      // Parse the coordinates of the vectors here:

      // (your code goes here... )
      t0_xaxis_x_values.Add(Convert.ToDouble(dataColumns[4]));
      t0_xaxis_y_values.Add(Convert.ToDouble(dataColumns[5]));
      t0_xaxis_z_values.Add(Convert.ToDouble(dataColumns[6]));
      t0_yaxis_x_values.Add(Convert.ToDouble(dataColumns[7]));
      t0_yaxis_y_values.Add(Convert.ToDouble(dataColumns[8]));
      t0_yaxis_z_values.Add(Convert.ToDouble(dataColumns[9]));

    }

    // Finally, remember to add more outputs to this GH component,
    // and output the Lists of data you just parsed.
    timestamps = timestamp_values;
    t0_origin_x = t0_origin_x_values;
    t0_origin_y = t0_origin_y_values;
    t0_origin_z = t0_origin_z_values;
    t0_pressed = t0_pressed_values;

    // (your code goes here... )
    t0_xaxis_x = t0_xaxis_x_values;
    t0_xaxis_y = t0_xaxis_y_values;
    t0_xaxis_z = t0_xaxis_z_values;
    t0_yaxis_x = t0_yaxis_x_values;
    t0_yaxis_y = t0_yaxis_y_values;
    t0_yaxis_z = t0_yaxis_z_values;
# ---------- end c_script_3 ----------

# ---- group: To view these planes on the viewport, make sure you go to Display > Preview Plane Size > set the value to around 20 units
pln = Plane(c_script_2.t0_planes)

# ----
pln_2 = Plane(c_script.t0_planes)
cone = Cone(Base=pln, Radius=Slider(0.1, range=0..1), Length=Slider(10, range=0..10))  # -> Cone, Tip

# ---- group: A simple example of how to read the CSV file into its individual data points
panel_4 = Panel(c_script_3.timestamps)
panel_5 = Panel(c_script_3.t0_origin_x)
panel_6 = Panel(c_script_3.t0_xaxis_x)
panel_7 = Panel(c_script_3.t0_yaxis_x)
panel_8 = Panel(c_script_3.t0_origin_y)
panel_9 = Panel(c_script_3.t0_xaxis_y)
panel_10 = Panel(c_script_3.t0_yaxis_y)
panel_11 = Panel(c_script_3.t0_origin_z)
panel_12 = Panel(c_script_3.t0_xaxis_z)
panel_13 = Panel(c_script_3.t0_yaxis_z)
panel_14 = Panel(c_script_3.t0_pressed)

# ---- group: Also simple example of how to read the CSV file, this time outputting geometry elements
panel_15 = Panel(c_script_2.t0_planes)
panel_16 = Panel(c_script_2.t0_pressed)

# ----
nurbs = NurbsCurve(Vertices=c_script_2.t0_planes, Degree=3, Periodic=False)  # -> Curve, Length, Domain

c_script_4 = CSharpScript(planes=c_script.t0_planes, maxHeight=Slider(5, range=0..5), radius=Slider(0.008, range=0..2))  # -> polyline, curve, lines, spheres1, spheres2, graphPoly, loft, lengths; inputs planes: list of Plane, maxHeight: Double, radius: Double
# ---------- c_script_4: C# ----------
    // sphere geometry on origin
    /* Sphere s = new Sphere(planes, radius);
    spheres1 = s; */
    // take all origins
    var origins = new List<Point3d>();
    for (int i = 1; i < planes.Count; i++)
    {
      origins.Add(planes[i].Origin);
    }

    Polyline poly = new Polyline(origins);

    // create curve
    Curve c = Curve.CreateInterpolatedCurve(origins, 3);

    // list of lines perpendicular to each plane.
    // height is based on distance between consecutive planes
    var lin = new List <Line>();
    /*
    List<Sphere> Sp1 = new List <Sphere>();
    List<Sphere> sp2 = new List <Sphere>(); */

    var Sp1 = new List <Point3d>();
    var Sp2 = new List <Point3d>();

    for (int i = 1; i < planes.Count; i++)
    {
      Plane p = planes[i];
      Plane prevP = planes[i - 1];
      double dist = p.Origin.DistanceTo(prevP.Origin);
      double factor = dist;
      Line l = LinePerpendicularToPlane(p, factor * maxHeight);
      lin.Add(l);
      /*s1 = Sphere(l.From, radius);                    // why is it not working
      Sp1.Add(s1);
      s2 = Sphere(l.To, radius);                    // why is it not working
      Sp1.Add(s2);
 */
      Point3d spOrig = l.From;

      Sp1.Add(spOrig);
      Point3d spEnd = l.To;
      Sp2.Add(spEnd);



      // generating lines normal to the plane
      Vector3d translation = new Vector3d();
      translation = p.ZAxis * maxHeight;        // creates a vector in the normal direction with the height
      Point3d endPoint = p.Origin + translation;      // creates a point at the end point of the vector

    }
    Sphere s1 = new Sphere(Sp1, radius);
    Sphere s2 = new Sphere(Sp2, radius);


    // sphere geometry on origin
    // Sphere s1 = new Sphere(planes.Origin, radius);
    spheres1 = s1;
    spheres2 = s2;

    // Polyline with speed of the motion
    var graphPoints = new List<Point3d>();
    foreach (Line line in lin)
    {
      graphPoints.Add(line.To);
    }

    var lineLengths = new List<double>();
    foreach (Line line in lin)
    {

      lineLengths.Add(line.Length);
    }

    Polyline graph = new Polyline(graphPoints);

    // Loft
    // convert lines to curves
    var curvedLines = new List<Curve>();
    foreach(Line l in lin){
      curvedLines.Add(l.ToNurbsCurve());
    }

    Brep[] srf = Brep.CreateFromLoft(curvedLines, Point3d.Unset, Point3d.Unset, LoftType.Straight, false);

    polyline = poly;
    curve = c;
    lines = lin;
    graphPoly = graph;
    loft = srf;
    lengths = lineLengths;
# ---------- c_script_4: C# additional code ----------
  Line LinePerpendicularToPlane(Plane pl, double height)
  {
    // Line
    Vector3d translation = pl.ZAxis * height;
    Point3d endPoint = pl.Origin + translation;
    Line l = new Line(pl.Origin, endPoint);
    return l;
  }
# ---------- end c_script_4 ----------
geo = Geometry(c_script_4.curve)
geo_2 = Geometry(c_script_4.polyline)
geo_3 = Geometry(c_script_4.lines)
geo_4 = Geometry(c_script_4.loft)
geo_5 = Geometry(c_script_4.spheres1)
geo_6 = Geometry(c_script_4.spheres2)
geo_7 = Geometry(c_script_4.graphPoly)

c_script_5 = CSharpScript(planes=c_script.t0_planes)  # -> trajectory; inputs planes: list of Plane
# ---------- c_script_5: C# ----------
    // And some bonus sample code:
    // let's create a polyline over all the planes,
    // and place spheres on those moments where the user pressed the screen!

    // To create a Polyline object, we need a List of points.
    // Since what we have is Planes, we need to extract all the
    // origins into a new list and use that to create the Polyline:
    List<Point3d> origins = new List<Point3d>();
    for (int i = 0; i < planes.Count; i++) {
      Point3d orig = planes[i].Origin;
      origins.Add(orig);
    }
    Polyline poly = new Polyline(origins);

    

    // Outputs
    trajectory = poly;
# ---------- end c_script_5 ----------
geo_8 = Geometry(c_script_5)

height = Slider(1, range=-20..20)
width1 = Slider(0.01, range=-20..2)
width2 = Slider(0.05, range=-2..2)
c_script_6 = CSharpScript(plane=c_script.t0_planes, radius=Slider(0.008, range=0..2), height=height, width1=width1, width2=width2)  # -> sphere, cone, box, line; inputs plane: Plane, radius: Double, height: Double, width1: Double, width2: Double
# ---------- c_script_6: C# ----------
    // sphere geometry on origin
    Sphere s = new Sphere(plane, radius);
    sphere = s;

    // cone geometry on origin
    Cone c = new Cone(plane, -1 * height, radius);
    cone = c;

    // box geometry
    Interval iX = new Interval(-0.5 * width1, 0.5 * width1);
    Interval iY = new Interval(-0.5 * width2, 0.5 * width2);
    Interval iZ = new Interval(0.25 * height, -0.25 * height);
    Box b = new Box(plane, iX, iY, iZ);

    box = b;

    // generating lines normal to the plane
    Vector3d translation = new Vector3d();
    translation = plane.ZAxis * height;        // creates a vector in the normal direction with the height
    Point3d endPoint = plane.Origin + translation;      // creates a point at the end point of the vector
    Line l = new Line(plane.Origin, endPoint);

    line = l;
# ---------- end c_script_6 ----------
geo_9 = Geometry(c_script_6.sphere)
geo_10 = Geometry(c_script_6.cone)
geo_11 = Geometry(c_script_6.box)
geo_12 = Geometry(c_script_6.line)

c_script_7 = CSharpScript(planes=c_script.t0_planes, maxHeight=Slider(0.64, range=0..3))  # -> polyline, curve, lines; inputs planes: list of Plane, maxHeight: Double
# ---------- c_script_7: C# ----------
    // take all origins
    var origins = new List<Point3d>();
    for (int i = 1; i < planes.Count; i++)
    {
      origins.Add(planes[i].Origin);
    }

    Polyline poly = new Polyline(origins);

    // create curve
    Curve c = Curve.CreateInterpolatedCurve(origins, 3);

    // list of lines perpendicular to each plane.
    var lin = new List <Line>();
    for (int i = 0; i < planes.Count; i++)
    {
      Plane p = planes[i];
      double factor = Math.Sin(2 * Math.PI * i / (double) planes.Count);   // the value will reach one as it reaches total number of planes
      Line l = LinePerpendicularToPlane(p, factor * maxHeight);
      lin.Add(l);
    }




    polyline = poly;
    curve = c;
    lines = lin;
# ---------- c_script_7: C# additional code ----------
  Line LinePerpendicularToPlane(Plane pl, double height)
  {
    // Line
    Vector3d translation = pl.ZAxis * height;
    Point3d endPoint = pl.Origin + translation;
    Line l = new Line(pl.Origin, endPoint);
    return l;
  }
# ---------- end c_script_7 ----------
geo_13 = Geometry(c_script_7.polyline)
geo_14 = Geometry(c_script_7.curve)
geo_15 = Geometry(c_script_7.lines)

c_script_8 = CSharpScript(planes=c_script.t0_planes, maxHeight=Slider(3, range=0..5))  # -> polyline, curve, lines, graphPoly, loft, lengths; inputs planes: list of Plane, maxHeight: Double
# ---------- c_script_8: C# ----------
    // take all origins
    var origins = new List<Point3d>();
    for (int i = 1; i < planes.Count; i++)
    {
      origins.Add(planes[i].Origin);
    }

    Polyline poly = new Polyline(origins);

    // create curve
    Curve c = Curve.CreateInterpolatedCurve(origins, 3);

    // list of lines perpendicular to each plane.
    // height is based on distance between consecutive planes
    var lin = new List <Line>();
    for (int i = 1; i < planes.Count; i++)
    {
      Plane p = planes[i];
      Plane prevP = planes[i - 1];
      double dist = p.Origin.DistanceTo(prevP.Origin);
      double factor = dist;
      Line l = LinePerpendicularToPlane(p, factor * maxHeight);
      lin.Add(l);
    }

    // Polyline with speed of the motion
    var graphPoints = new List<Point3d>();
    foreach (Line line in lin)
    {
      graphPoints.Add(line.To);
    }

    var lineLengths = new List<double>();
    foreach (Line line in lin)
    {

      lineLengths.Add(line.Length);
    }

    Polyline graph = new Polyline(graphPoints);

    // Loft
    // convert lines to curves
    var curvedLines = new List<Curve>();
    foreach(Line l in lin){
      curvedLines.Add(l.ToNurbsCurve());
    }

    Brep[] srf = Brep.CreateFromLoft(curvedLines, Point3d.Unset, Point3d.Unset, LoftType.Straight, false);

    polyline = poly;
    curve = c;
    lines = lin;
    graphPoly = graph;
    loft = srf;
    lengths = lineLengths;
# ---------- c_script_8: C# additional code ----------
  Line LinePerpendicularToPlane(Plane pl, double height)
  {
    // Line
    Vector3d translation = pl.ZAxis * height;
    Point3d endPoint = pl.Origin + translation;
    Line l = new Line(pl.Origin, endPoint);
    return l;
  }
# ---------- end c_script_8 ----------
geo_16 = Geometry(c_script_8.polyline)
geo_17 = Geometry(c_script_8.curve)
geo_18 = Geometry(c_script_8.lines)
geo_19 = Geometry(c_script_8.graphPoly)
geo_20 = Geometry(c_script_8.loft)

pipe = Pipe(Curve=nurbs.Curve, Radius=Slider(0.1, range=0..1), Caps=0)
panel_17 = Panel(c_script_8.lengths)

# ---- group: And just a simple example to inspire you!
c_script_9 = CSharpScript(planes=c_script_2.t0_planes, pressed=c_script_2.t0_pressed, radius=Slider(6.6, range=0..10))  # -> out, trajectory, pressedBubbles; inputs planes: list of Plane, pressed: list of Boolean, radius: Double
# ---------- c_script_9: C# ----------
    // And some bonus sample code:
    // let's create a polyline over all the planes,
    // and place spheres on those moments where the user pressed the screen!

    // To create a Polyline object, we need a List of points.
    // Since what we have is Planes, we need to extract all the
    // origins into a new list and use that to create the Polyline:
    List<Point3d> origins = new List<Point3d>();
    for (int i = 0; i < planes.Count; i++) {
      Point3d orig = planes[i].Origin;
      origins.Add(orig);
    }
    Polyline poly = new Polyline(origins);

    // Now, let's create an empty list of sphere objects,
    // and only create them if there was a `pressed` event:
    List<Sphere> spheres = new List<Sphere>();
    for (int i = 9; i < pressed.Count; i++) {
      bool wasPressed = pressed[i];
      if (wasPressed == true) {
        Sphere s = new Sphere(planes[i], radius);
        spheres.Add(s);
      }
    }

    // Outputs
    trajectory = poly;
    pressedBubbles = spheres;
# ---------- end c_script_9 ----------
geo_21 = Geometry(c_script_9.trajectory)
geo_22 = Geometry(c_script_9.pressedBubbles)
