# Grasshopper definition circle relaxation_kritika.gh (Grasshopper 1.0.7)

# ---- group: Let's use GH to read the CSV file into a List of strings. Make sure you replace the incoming path with wherever your file lives.
# #GSD6338
# Introduction to Computational Design
# Instructor: Jose Luis García del Castillo y López
# Harvard University Graduate School of Design
# Fologram_MotionTracker - CSV Data Reader
# This file contains a sample Grasshopper definition to read recorded motion information from a CSV file and reconstruct it in different ways.
# This file uses the Fologram plug-in to read from the phone and tablet: https://fologram.com/
# Authors: Joonhaeng Lee, Jose Luis García del Castillo y Lopez.
# 
# This file is part of a class assignment for GSD6338: Introduction to Computational Design.
# More info on: https://www.gsd.harvard.edu/course/introduction-to-computational-design-fall-2020/
panel = Panel("C:\Users\KRKH\Desktop\Kritika\Harvard GSD\Fall 2020 Courses\GSD-6338  Introduction to Computational Design\assignment[0]\Recording_0mzt.csv")
file = ReadFile(File=panel, PerLineParse=True)

# ---- group: A simple example of how to read the CSV file into its individual data points / Double-click me to learn more!
c_script = CSharpScript(data=file)  # -> out, timestamps, t0_origin_x, t0_origin_y, t0_origin_z, t0_xaxis_x, t0_xaxis_y, t0_xaxis_z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; inputs data: list of String
# ---------- c_script: C# usings ----------
using System.IO;
using System.Linq;
using System.Data;
using System.Drawing;
using System.Reflection;
using System.Windows.Forms;
using System.Xml;
using System.Xml.Linq;
using System.Runtime.InteropServices;

using Rhino.DocObjects;
using Rhino.Collections;
using GH_IO;
using GH_IO.Serialization;
# ---------- c_script: C# ----------
    // In this file, we will parse the CSV file with the recording, and get the values
    // of the objects as numerical lists.
    // Before starting to add your own code, we recommend you read through the whole
    // file, understand the code that is already given to you, and get a sense of
    // what you are asked to complete! :)

    // Let's create a bunch of lists to store all the indidivual components of the input data!
    // If instead of outputtting individual values, you would like to ouput
    // actual geometrical objects, look at the next example in this GH file.

    // Timestamps must be stored as longs (really big integers):
    List<long> timestamp_values = new List<long>();

    // Point/vector components can be stored as doubles:
    List<double> t0_origin_x_values = new List<double>();
    List<double> t0_origin_y_values = new List<double>();
    List<double> t0_origin_z_values = new List<double>();

    // We will help you with a sample for boolean values:
    List<bool> t0_pressed_values = new List<bool>();

    // This is an incomplete list of incoming data -->
    // --> you should complete these lists, adding more here to store
    //     the values of the axes or other additional devices, etc.
    // Craete lists of doubles for the coordinates of the two
    // direction vectors.

    // (your code goes here... )
    List<double> t0_xaxis_x_values = new List<double>();
    List<double> t0_xaxis_y_values = new List<double>();
    List<double> t0_xaxis_z_values = new List<double>();
    List<double> t0_yaxis_x_values = new List<double>();
    List<double> t0_yaxis_y_values = new List<double>();
    List<double> t0_yaxis_z_values = new List<double>();



    // Let's iterate over all the string in the incoming data list, one per line.
    // Notice how we start with 1, because we want to skip the header in the file.
    for (int i = 1; i < data.Count; i++) {
      // Let's retrieve a line will all the data
      string dataRow = data[i];

      // Because it is a Comma-Separated Values (CSV) list, we values are separated with commas.
      // If we split the string with commas, we can get an array of strings with the individual values!
      // https://docs.microsoft.com/en-us/dotnet/api/system.string.split?view=netframework-4.5
      string[] dataColumns = dataRow.Split(',');  // notice how we use single quotes to indicate a char input

      // Let's get the timestamp! We know it was on the first column, so must be the first element
      // in the array. However, remember we read it as a string, so we must convert it to long first!
      // Then, we just push it to the appropriate list.
      string tsString = dataColumns[0];
      long ts = Convert.ToInt64(tsString);  // `long` is actually a nickname for `int64`, an integer with 64 bits capacity!
      timestamp_values.Add(ts);

      // Same thing with the coordinates of the origin of the first tracker:
      // - Retrieve the string element from the row,
      // - convert it to a double, and
      // - add it to the corresponding list.
      // As opposed to the long before, where we split each step of the process in one line of code,
      // ee will be shorthanding these three operations in one line:
      t0_origin_x_values.Add(Convert.ToDouble(dataColumns[1]));
      t0_origin_y_values.Add(Convert.ToDouble(dataColumns[2]));
      t0_origin_z_values.Add(Convert.ToDouble(dataColumns[3]));

      // And the final example, importing a boolean value!
      // Interestingly, this value is stored as an integer (0 or 1),
      // which is a very common representation of boolean values on CSVs.
      // We will need to read the string, convert it to an integer, and then to a boolean!
      int pressedNum = Convert.ToInt32(dataColumns[10]);
      bool pressed = pressedNum == 1;
      t0_pressed_values.Add(pressed);


      // That's it! With these examples, you probably have a good start on how to parse
      // the rest of the data back into Grasshopper. Just create more empty lists above,
      // and in this for loop, take elements from each row, convert them to their appropiate
      // type, and then push them to their appropriate lists.
      // You can parse through the whole CSV file with this technique.
      // Parse the coordinates of the vectors here:

      // (your code goes here... )
      t0_xaxis_x_values.Add(Convert.ToDouble(dataColumns[4]));
      t0_xaxis_y_values.Add(Convert.ToDouble(dataColumns[5]));
      t0_xaxis_z_values.Add(Convert.ToDouble(dataColumns[6]));
      t0_yaxis_x_values.Add(Convert.ToDouble(dataColumns[7]));
      t0_yaxis_y_values.Add(Convert.ToDouble(dataColumns[8]));
      t0_yaxis_z_values.Add(Convert.ToDouble(dataColumns[9]));

    }

    // Finally, remember to add more outputs to this GH component,
    // and output the Lists of data you just parsed.
    timestamps = timestamp_values;
    t0_origin_x = t0_origin_x_values;
    t0_origin_y = t0_origin_y_values;
    t0_origin_z = t0_origin_z_values;
    t0_pressed = t0_pressed_values;

    // (your code goes here... )
    t0_xaxis_x = t0_xaxis_x_values;
    t0_xaxis_y = t0_xaxis_y_values;
    t0_xaxis_z = t0_xaxis_z_values;
    t0_yaxis_x = t0_yaxis_x_values;
    t0_yaxis_y = t0_yaxis_y_values;
    t0_yaxis_z = t0_yaxis_z_values;
# ---------- end c_script ----------

# ----
panel_2 = Panel(file)

# ---- group: Also simple example of how to read the CSV file, this time outputting geometry elements / Double-click me to learn more!
c_script_2 = CSharpScript(data=file)  # -> out, t0_planes, t0_pressed; inputs data: list of String
# ---------- c_script_2: C# ----------
    // You have seen in the previous example how to read the CSV in an "atomic" way, element by element.
    // However, most likely, you will want to end up reconstructing that data back
    // into Points, Vectors and / or Planes. So why not doing it right away?
    // This example is very similar to the previous one, except that instead of outputting
    // the numerical values representing the origin Point for the first tracker,
    // we will output a List of actual Point3d objects!
    // (Remember, to read more about how to output doubles, booleans or longs,
    // check the previous example. We will ignore that part in this one.)
    // Read the whole file before modifying it!

    // Since we now want to output geometry, let's create an empty list of Point3d
    List<Point3d> t0_origin_point_values = new List<Point3d>();

    // We still will keep the pressed values as single booleans...
    List<bool> t0_pressed_values = new List<bool>();

    // You can now add more lists of Points, Vectors and/or probably Plane objects here!
    // (your code goes here... )
    List<Plane> t0_plane_objects = new List<Plane>();



    // Let's iterate over all the string in the incoming data list, one per line.
    // Notice how we start with 1, because we want to skip the header in the file.
    for (int i = 1; i < data.Count; i++) {
      // Let's retrieve a line will all the data
      string dataRow = data[i];

      // Because it is a Comma-Separated Values (CSV) list, we values are separated with commas.
      // If we split the string with commas, we can get an array of strings with the individual values!
      // https://docs.microsoft.com/en-us/dotnet/api/system.string.split?view=netframework-4.5
      string[] dataColumns = dataRow.Split(',');  // notice how we use single quotes to indicate a char input

      // Bringing in the booleans for `pressed`, just like we did in the previous component.
      int pressedNum = Convert.ToInt32(dataColumns[10]);
      bool pressed = pressedNum == 1;
      t0_pressed_values.Add(pressed);

      // We learnt how to read doubles, longs, bools, etc. before, so let's focus on geometry.
      // If I want to output the origin Point of the tracker, I will probably have to:
      // - Read the string coordinates of the point,
      // - convert them to doubles,
      // - create a Point3d object with them,
      // - and store the point object in my Point3d List.
      // Let's do it!
      double oX = Convert.ToDouble(dataColumns[1]);  // shorthanding reading and converting to double
      double oY = Convert.ToDouble(dataColumns[2]);
      double oZ = Convert.ToDouble(dataColumns[3]);
      Point3d origin = new Point3d(oX, oY, oZ);
      t0_origin_point_values.Add(origin);

      // // The code above could be shorthanded in one line, but it becomes very hard to read... :(
      // t0_origin_point_values.Add(new Point3d(Convert.ToDouble(dataColumns[1]), Convert.ToDouble(dataColumns[2]), Convert.ToDouble(dataColumns[3])));

      // That's pretty much it! Try now importing and constructing the direction Vectors for the tracker.
      // Or... wouldn't it just be easier to directly construct a Plane object for the
      // tracker with the Origin and the two main Vectors...? :)
      // Write code here to create two vectors from the coordinates in the CSV,
      // and either store them on lists or use them along with the origin point
      // to create a Plane object and store that one on a list for outputting! (RECOMMENDED)

      // (your code goes here... )
      Vector3d vx = new Vector3d(
        Convert.ToDouble(dataColumns[4]),
        Convert.ToDouble(dataColumns[5]),
        Convert.ToDouble(dataColumns[6]));
      Vector3d vy = new Vector3d(
        Convert.ToDouble(dataColumns[7]),
        Convert.ToDouble(dataColumns[8]),
        Convert.ToDouble(dataColumns[9]));

      Plane pl = new Plane(origin, vx, vy);
      t0_plane_objects.Add(pl);
    }

    // Finally, remember to add more outputs to this GH component,
    // and output the Lists of geometry you just created.
    // t0_origin_points = t0_origin_point_values;

    // Output here your list of `pressed` booleans,
    // and your direction vectors or your orientation plane!
    // (your code goes here... )
    t0_planes = t0_plane_objects;
    t0_pressed = t0_pressed_values;
# ---------- end c_script_2 ----------

# ---- group: To view these planes on the viewport, make sure you go to Display > Preview Plane Size > set the value to around 20 units
pln = Plane(c_script_2.t0_planes)

# ---- group: A simple example of how to read the CSV file into its individual data points
panel_3 = Panel(c_script.timestamps)
panel_4 = Panel(c_script.t0_origin_x)
panel_5 = Panel(c_script.t0_xaxis_x)
panel_6 = Panel(c_script.t0_yaxis_x)
panel_7 = Panel(c_script.t0_origin_y)
panel_8 = Panel(c_script.t0_xaxis_y)
panel_9 = Panel(c_script.t0_yaxis_y)
panel_10 = Panel(c_script.t0_origin_z)
panel_11 = Panel(c_script.t0_xaxis_z)
panel_12 = Panel(c_script.t0_yaxis_z)
panel_13 = Panel(c_script.t0_pressed)

# ---- group: Also simple example of how to read the CSV file, this time outputting geometry elements
panel_14 = Panel(c_script_2.t0_planes)
panel_15 = Panel(c_script_2.t0_pressed)

# ----
c_script_3 = CSharpScript(t0_origin_x=c_script.t0_origin_x, t0_origin_y=c_script.t0_origin_y, t0_origin_z=c_script.t0_origin_z)  # -> out, OPoints; inputs t0_origin_x: list of Double, t0_origin_y: list of Double, t0_origin_z: list of Double
# ---------- c_script_3: C# ----------
    List<Point3d> list = new List<Point3d>();

    for (int i = 0; i < t0_origin_x.Count; i++)
    {
      list.Add(new Point3d { X = t0_origin_x[i], Y = t0_origin_y[i], Z = t0_origin_z[i] });
    }

    OPoints = list;
# ---------- end c_script_3 ----------
timer = Timer(TimerInterval=50, Target=c_script_4)
c_script_4 = CSharpScript(iReset=Button(), iStartingPositions=c_script_3.out, iMaxCenterCount="1500")  # -> out, oCenters; inputs iReset: Boolean, iStartingPositions: list of Point3d, iMaxCenterCount: Int32; disabled
# ---------- c_script_4: C# ----------
    if (iReset || centers == null)
      centers = new List<Point3d>(iStartingPositions);

    List<Vector3d> totalMoves = new List<Vector3d>();
    List<double> collisionCounts = new List<double>();

    for (int i = 0; i < centers.Count; i++)
    {
      totalMoves.Add(new Vector3d(0.0, 0.0, 0.0));
      collisionCounts.Add(0.0);
    }

    double collisionDistance = 2.0;

    for (int i = 0; i < centers.Count; i++)
      for (int j = i + 1; j < centers.Count; j++)
      {
        double d = centers[i].DistanceTo(centers[j]);
        if (d > collisionDistance) continue;
        Vector3d move = centers[i] - centers[j];
        if (move.Length < 0.001) continue;
        move.Unitize();
        move *= 0.5 * (collisionDistance - d);
        totalMoves[i] += move;
        totalMoves[j] -= move;
        collisionCounts[i] += 1.0;
        collisionCounts[j] += 1.0;
      }

    for (int i = 0; i < centers.Count; i++)
      if (collisionCounts[i] != 0.0)
        centers[i] += totalMoves[i] / collisionCounts[i];

    if (centers.Count < iMaxCenterCount)
    {
      List<int> splitIndices = new List<int>();

      for (int i = 0; i < centers.Count - 1; i++)
        if (centers[i].DistanceTo(centers[i + 1]) > 1.99)
          splitIndices.Add(i + 1 + splitIndices.Count);

      foreach (int splitIndex in splitIndices)
      {
        Point3d newCenter = 0.5 * (centers[splitIndex - 1] + centers[splitIndex]);
        centers.Insert(splitIndex, newCenter);
      }
    }


    oCenters = centers;
# ---------- c_script_4: C# additional code ----------
  List<Point3d> centers;
# ---------- end c_script_4 ----------
pt = Point(c_script_4.oCenters)

# ---- group: And just a simple example to inspire you!
number_slider = Slider(10, range=0..10)
c_script_5 = CSharpScript(planes=c_script_2.t0_planes, pressed=c_script_2.t0_pressed, radius=number_slider)  # -> out, trajectory, pressedBubbles; inputs planes: list of Plane, pressed: list of Boolean, radius: Double
# ---------- c_script_5: C# ----------
    // And some bonus sample code:
    // let's create a polyline over all the planes,
    // and place spheres on those moments where the user pressed the screen!

    // To create a Polyline object, we need a List of points.
    // Since what we have is Planes, we need to extract all the
    // origins into a new list and use that to create the Polyline:
    List<Point3d> origins = new List<Point3d>();
    for (int i = 0; i < planes.Count; i++) {
      Point3d orig = planes[i].Origin;
      origins.Add(orig);
    }
    Polyline poly = new Polyline(origins);

    // Now, let's create an empty list of sphere objects,
    // and only create them if there was a `pressed` event:
    List<Sphere> spheres = new List<Sphere>();
    for (int i = 9; i < pressed.Count; i++) {
      bool wasPressed = pressed[i];
      if (wasPressed == true) {
        Sphere s = new Sphere(planes[i], radius);
        spheres.Add(s);
      }
    }

    // Outputs
    trajectory = poly;
    pressedBubbles = spheres;
# ---------- end c_script_5 ----------
geo = Geometry(c_script_5.trajectory)
geo_2 = Geometry(c_script_5.pressedBubbles)

# ----
c_script_6 = CSharpScript(planes=c_script_2.t0_planes, pressed=c_script_2.t0_pressed, radius=number_slider)  # -> out, trajectory, pressedBubbles; inputs planes: list of Plane, pressed: list of Boolean, radius: Double
# ---------- c_script_6: C# ----------
    // And some bonus sample code:
    // let's create a polyline over all the planes,
    // and place spheres on those moments where the user pressed the screen!

    // To create a Polyline object, we need a List of points.
    // Since what we have is Planes, we need to extract all the
    // origins into a new list and use that to create the Polyline:
    List<Point3d> origins = new List<Point3d>();
    for (int i = 0; i < planes.Count; i++) {
      Point3d orig = planes[i].Origin;
      origins.Add(orig);
    }
    Polyline poly = new Polyline(origins);

    // Now, let's create an empty list of sphere objects,
    // and only create them if there was a `pressed` event:
    List<Box> spheres = new List<Box>();
    for (int i = 9; i < pressed.Count; i++) {
      bool wasPressed = pressed[i];
      if (wasPressed == false) {
        Interval interv1 = new Interval (-radius, radius);
        Box b = new Box(planes[i], interv1, interv1, interv1);
        spheres.Add(b);
      }
    }

    // Outputs
    //trajectory = poly;
    pressedBubbles = spheres;
# ---------- end c_script_6 ----------
c_script_7 = CSharpScript(planes=c_script_2.t0_planes, pressed=c_script_2.t0_pressed, radius=number_slider)  # -> out, trajectory, pressedBubbles; inputs planes: list of Plane, pressed: list of Boolean, radius: Double
# ---------- c_script_7: C# ----------
    // And some bonus sample code:
    // let's create a polyline over all the planes,
    // and place spheres on those moments where the user pressed the screen!

    // To create a Polyline object, we need a List of points.
    // Since what we have is Planes, we need to extract all the
    // origins into a new list and use that to create the Polyline:
    List<Point3d> origins = new List<Point3d>();
    for (int i = 0; i < planes.Count; i++) {
      Point3d orig = planes[i].Origin;
      origins.Add(orig);
    }
    Polyline poly = new Polyline(origins);

    // Now, let's create an empty list of sphere objects,
    // and only create them if there was a `pressed` event:
    List<Box> boxes = new List<Box>();
    for (int i = 9; i < pressed.Count; i++) {
      bool wasPressed = pressed[i];
      if (wasPressed == false) {
        Interval interv1 = new Interval (-radius, radius);
        Box b = new Box(planes[i], interv1, interv1, interv1);
        Interval interv2 = new Interval(-radius / 2.0, radius / 2.0);
        Plane pl_new = new Plane(planes[i].Origin + planes[i].Normal * radius, planes[i].XAxis, planes[i].YAxis);
        Box b2 = new Box(pl_new, interv2, interv2, interv2);
        boxes.Add(b);
        boxes.Add(b2);
      }
    }

    // Outputs
    //trajectory = poly;
    pressedBubbles = boxes;
# ---------- end c_script_7 ----------
c_script_8 = CSharpScript(planes=c_script_2.t0_planes, pressed=c_script_2.t0_pressed, radius=number_slider)  # -> out, Nurbs, Interpolate, Rebuild; inputs planes: list of Plane, pressed: list of Boolean, radius: Double
# ---------- c_script_8: C# ----------
    // And some bonus sample code:
    // let's create a polyline over all the planes,
    // and place spheres on those moments where the user pressed the screen!

    // To create a Polyline object, we need a List of points.
    // Since what we have is Planes, we need to extract all the
    // origins into a new list and use that to create the Polyline:
    List<Point3d> origins = new List<Point3d>();
    for (int i = 0; i < planes.Count; i++) {
      Point3d orig = planes[i].Origin;
      origins.Add(orig);
    }
    Polyline poly = new Polyline(origins);

    List<Vector3d> normals = new List<Vector3d>();
    for (int i = 0; i < planes.Count; i++) {
      Vector3d nv = planes[i].Normal;
      normals.Add(nv);
    }

    //Making the Curves
    NurbsCurve nCurve = NurbsCurve.Create(false, 3, origins);
    Curve iCur = Curve.CreateInterpolatedCurve(origins, 3);

    //rebuild
    int pt_count = 100;
    List<double> param = iCur.DivideByCount(pt_count, true).ToList();
    List<Point3d> divided = new List<Point3d>();
    for (int i = 0; i < param.Count; i++)
    {
      divided.Add(iCur.PointAt(param[i]));
    }

    Curve re_cur = Curve.CreateInterpolatedCurve(divided, 3);

    PointCloud ori_cld = new PointCloud(origins);
    List<Vector3d> new_Normals = new List<Vector3d>();
    for(int i = 0; i < divided.Count; i++)
    {
      new_Normals.Add(normals[ori_cld.ClosestPoint(divided[i])]);
    }

    Point3d O = new Point3d(0, 0, 0);
    List<Vector3d> target_Vec = new List<Vector3d>();
    for (int i = 0; i < divided.Count; i++)
    {
      Vector3d v = new Vector3d(O - divided[i]);
      v.Unitize();
      target_Vec.Add(v);
    }

    List<Curve> drop_line = new List<Curve>();
    for(int i = 0; i < divided.Count; i++)
    {
      Point3d end = divided[i] + target_Vec[i] * (Math.Sin(i) * 30 + 50);
    }
    // Outputs
    Nurbs = nCurve;
    Interpolate = iCur;
    Rebuild = re_cur;
# ---------- end c_script_8 ----------
c_script_9 = CSharpScript(planes=c_script_2.t0_planes, pressed=c_script_2.t0_pressed, radius=number_slider)  # -> out, Nurbs, Interpolate; inputs planes: list of Plane, pressed: list of Boolean, radius: Double
# ---------- c_script_9: C# ----------
    // And some bonus sample code:
    // let's create a polyline over all the planes,
    // and place spheres on those moments where the user pressed the screen!

    // To create a Polyline object, we need a List of points.
    // Since what we have is Planes, we need to extract all the
    // origins into a new list and use that to create the Polyline:
    List<Point3d> origins = new List<Point3d>();
    for (int i = 0; i < planes.Count; i++) {
      Point3d orig = planes[i].Origin;
      origins.Add(orig);
    }
    Polyline poly = new Polyline(origins);

    List<Vector3d> normals = new List<Vector3d>();
    for (int i = 0; i < planes.Count; i++) {
      Vector3d nv = planes[i].Normal;
      normals.Add(nv);
    }

    //Polyline poly = new Polyline(origins);
    NurbsCurve nCurve = NurbsCurve.Create(false, 3, origins);
    Curve iCur = Curve.CreateInterpolatedCurve(origins, 3);
    // Outputs
    Nurbs = nCurve;
    Interpolate = iCur;
# ---------- end c_script_9 ----------
geo_3 = Geometry(c_script_6.pressedBubbles)
geo_4 = Geometry(c_script_7.pressedBubbles)
area = Area(Geometry=geo_4)  # -> Area, Centroid

# ----
# Canon
origin_point = Point([Point(-2.979934216, -0.6038371921, 0.6686864495), Point(-2.980418205, -0.6026253104, 0.6683148742), Point(-2.981040955, -0.6031700373, 0.6669421792), Point(-2.98161912, -0.603083849, 0.6656229496), Point(-2.981492281, -0.6037840843, 0.6647593379), Point(-2.981155396, -0.6041821837, 0.6635068655)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])
timer_2 = Timer(TimerInterval=50, Target=c_script_10)
c_script_10 = CSharpScript(iReset=Button(), iStartingPositions=origin_point, iMaxCenterCount="1500")  # -> out, oCenters, n; inputs iReset: Boolean, iStartingPositions: list of Point3d, iMaxCenterCount: Int32; disabled
# ---------- c_script_10: C# ----------
    if (iReset || centers == null)
      centers = new List<Point3d>(iStartingPositions);

    List<Vector3d> totalMoves = new List<Vector3d>();
    List<double> collisionCounts = new List<double>();

    for (int i = 0; i < centers.Count; i++)
    {
      totalMoves.Add(new Vector3d(0.0, 0.0, 0.0));
      collisionCounts.Add(0.0);
    }

    double collisionDistance = 2.0;

    for (int i = 0; i < centers.Count; i++)
      for (int j = i + 1; j < centers.Count; j++)
      {
        double d = centers[i].DistanceTo(centers[j]);
        if (d > collisionDistance) continue;
        Vector3d move = centers[i] - centers[j];
        if (move.Length < 0.001) continue;
        move.Unitize();
        move *= 0.5 * (collisionDistance - d);
        totalMoves[i] += move;
        totalMoves[j] -= move;
        collisionCounts[i] += 1.0;
        collisionCounts[j] += 1.0;
      }

    for (int i = 0; i < centers.Count; i++)
      if (collisionCounts[i] != 0.0)
        centers[i] += totalMoves[i] / collisionCounts[i];

    if (centers.Count < iMaxCenterCount)
    {
      List<int> splitIndices = new List<int>();

      for (int i = 0; i < centers.Count - 1; i++)
        if (centers[i].DistanceTo(centers[i + 1]) > 1.99)
          splitIndices.Add(i + 1 + splitIndices.Count);

      foreach (int splitIndex in splitIndices)
      {
        Point3d newCenter = 0.5 * (centers[splitIndex - 1] + centers[splitIndex]);
        centers.Insert(splitIndex, newCenter);
      }
    }


    oCenters = centers;
    n = centers.Count;
# ---------- c_script_10: C# additional code ----------
  List<Point3d> centers;
# ---------- end c_script_10 ----------
number_slider_2 = Slider(0.12, range=0..2)
xy = XYPlane(Origin=Point(0, 0, 0))
cir = Circle(Plane=c_script_10.oCenters, Radius=number_slider_2)  # disabled

# ----
# Mozart
pt_2 = Point([Point(-2.962424994, -0.5382815003, 0.5626862645), Point(-2.962143898, -0.5380764008, 0.5627948642), Point(-2.962138176, -0.5380220413, 0.5626422763), Point(-2.962073565, -0.5382421613, 0.5625112653), Point(-2.961883545, -0.5378788114, 0.5623577237), Point(-2.961952925, -0.5378645062, 0.5622038245)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])
timer_3 = Timer(TimerInterval=50, Target=c_script_11)
c_script_11 = CSharpScript(iReset=Button(), iStartingPositions=pt_2, iMaxCenterCount="1500")  # -> out, oCenters; inputs iReset: Boolean, iStartingPositions: list of Point3d, iMaxCenterCount: Int32; disabled; same code as c_script_4
number_slider_3 = Slider(0.12, range=0..2)
pline = PolyLine(Vertices=c_script_11.oCenters, Closed=False)
panel_16 = Panel("1")
preview = CustomPreview(Geometry=pline, Material=ColourSwatch(SwatchColor=RGB(222, 189, 189)))

panel_17 = Panel(pt_2)
pt_3 = Point(c_script_10.oCenters)
voronoi = Voronoi(Points=c_script_10.oCenters, BruteForceOverride=False)
preview_2 = CustomPreview(Geometry=pt_3, Material=ColourSwatch(SwatchColor=RGB(227, 211, 211)))
pline_2 = PolyLine(Vertices=c_script_10.oCenters, Closed=False)
cir_2 = Circle(Plane=c_script_10.oCenters, Radius=number_slider_2)
c_script_12 = CSharpScript(radius=number_slider)  # -> out, trajectory, pressedBubbles; inputs planes: list of Plane, pressed: list of Boolean, radius: Double; same code as c_script_7
preview_3 = CustomPreview(Geometry=voronoi, Material=ColourSwatch(SwatchColor=RGB(219, 140, 140)))
panel_18 = Panel(c_script_12.out)

number_slider_4 = Slider(5, range=0..10)
pt_4 = Point([Point(-3.165694751, -2.377277569, -6.756763135), Point(-3.426855834, -0.5562612308, -5.972258933), Point(-3.710637941, 1.172955767, -5.008558783), Point(-2.248140577, 1.632869675, -3.685260715), Point(-3.576453385, 2.77637149, -0.5078875985), Point(-3.925730685, 1.163114946, 0.6146986069)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])
pt_5 = Point([Point(-2.3818746, -10.06822794, 6.084501108), Point(-3.327880666, -8.390633386, 6.575478421), Point(-4.315703143, -9.166882648, 5.071823966), Point(-5.236789253, -7.439784791, 4.828065565), Point(-6.311784168, -9.017510482, 4.287039266), Point(-3.729481414, -10.21099548, 2.552401061)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])
pt_6 = Point([Point(-9.199074633, -8.998080856, 2.479060298), Point(-10.08986157, -5.896416216, 2.140473945), Point(-9.703559285, -4.272775368, 0.4778956988), Point(-10.34046052, -6.480444413, 0.2441324073), Point(-8.001143606, -8.389992764, 0.3989406671), Point(-7.312651972, -9.552324858, -1.075835035)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])
line = LineSDL(Start=pt_5, Direction=Vector(0, 0, 1), Length=1)
line_2 = LineSDL(Start=pt_4, Direction=Vector(0, 0, 1), Length=1)
curvepoint = PointOnCurve(line, parameter=0)
curvepoint_2 = PointOnCurve(line_2, parameter=0)
curvepoint_3 = PointOnCurve(line, parameter=1)
curvepoint_4 = PointOnCurve(line_2, parameter=1)
swatch = ColourSwatch(SwatchColor=RGB(199, 177, 177))
swatch_2 = ColourSwatch(SwatchColor=RGB(199, 177, 177))
pline_3 = PolyLine(Vertices=curvepoint_3, Closed=False)
pline_4 = PolyLine(Vertices=curvepoint_4, Closed=False)
pline_5 = PolyLine(Vertices=curvepoint, Closed=False)
pline_6 = PolyLine(Vertices=curvepoint_2, Closed=False)
number_slider_5 = Slider(1.4, range=0..10)
Z = UnitZ(Factor=Slider(1, range=0..10))
loft = Loft(
    Curves=[pline_5, pline_3],
    Options={Adjust=False, Closed=False, LoftEnds=0, LoftSimp=0, LoftType=0, Rebuild=10, Refit=0.01})
preview_4 = CustomPreview(Geometry=pline_3, Material=ColourSwatch(SwatchColor=RGB(204, 196, 196)))
loft_2 = Loft(
    Curves=[pline_6, pline_4],
    Options={Adjust=False, Closed=False, LoftEnds=0, LoftSimp=0, LoftType=0, Rebuild=10, Refit=0.01})
preview_5 = CustomPreview(Geometry=pline_4, Material=ColourSwatch(SwatchColor=RGB(204, 196, 196)))
preview_6 = CustomPreview(Geometry=line, Material=ColourSwatch(SwatchColor=RGB(5, 0, 0)))
preview_7 = CustomPreview(Geometry=line, Material=ColourSwatch(SwatchColor=RGB(5, 0, 0)))
move = Move(Geometry=loft_2, Motion=Z)  # -> Geometry, Transform
scale_nu = ScaleNU(Geometry=loft, Plane=PlaneXY(0, 0, 0), ScaleX=Slider(2, range=0..10), ScaleY=number_slider_5, ScaleZ=number_slider_5)  # -> Geometry, Transform
scale_nu_2 = ScaleNU(Geometry=move.Geometry, Plane=PlaneXY(0, 0, 0), ScaleX=1, ScaleY=1, ScaleZ=Slider(2, range=0..10))  # -> Geometry, Transform
preview_8 = CustomPreview(Geometry=scale_nu.Geometry, Material=ColourSwatch(SwatchColor=RGBA(235, 120, 120, 16)))
preview_9 = CustomPreview(Geometry=scale_nu_2.Geometry, Material=ColourSwatch(SwatchColor=RGBA(51, 12, 12, 54)))
